# Grasshopper definition gHowl_UDP_send+receive.ghx (Grasshopper 0.9.75)
# plug-ins: Anemone, gHowl

port = Panel("7001")
udp_owl = UDPReceiver(Port=port, Pattern=0)  # -> Info, Data
panel = Panel(udp_owl.Data)
split = StringSplit(String=udp_owl.Data, Separators=";")
lng = ListLength(List=split)
# most basic loop:
panel_2 = Panel("10")
panel_3 = Panel(split)
# nested loop:
# will error out if loop end has diffferent number of data streams -
# just add empty param to the loop start
loop_start = LoopStart(Repeat=0, Data_0=split)  # -> port, Counter, Data_0, Data_1
loop_start_2 = LoopStart(Repeat=0, Data_0=split)  # -> port, Counter, Data_0
# loop with data list input:
# N-counter loops is 0-indexed and
# counter loops are in addition to the values of the data stream!
panel_4 = Panel("0")
loop_start_3 = LoopStart(Repeat=panel_2, Data_0="0")  # -> port, Counter, Data_0
panel_5 = Panel(loop_start.Data_0)
panel_6 = Panel(loop_start_2.Data_0)
loop_start_4 = LoopStart(Repeat=panel_4, Data_0=panel_3)  # -> port, Counter, Data_0
panel_7 = Panel(loop_start_3.Data_0)
split_2 = SplitList(List=loop_start.Data_0, Index="4")  # -> ListA, ListB
panel_8 = Panel(loop_start_4.Data_0)
partition = PartitionList(List=loop_start_2.Data_0, Size="4")
addition = Addition(A=loop_start_3.Data_0, B="4")
# try either domain box or center box!
panel_9 = Panel(split_2.ListB)
loop_start_5 = LoopStart(Repeat=0, Trigger=loop_start.Counter, Data_0=split_2.ListA, Data_1=split_2.ListB)  # -> port, Counter, Data_0, Data_1
panel_10 = Panel(partition)
addition_2 = Addition(A=loop_start_4.Data_0, B="4")
panel_11 = Panel(addition)
loop_end = LoopEnd(port=loop_start_3.port, Exit=False, Data_0=addition, pausedState=False, state="Constant & Record")
loop_start_6 = LoopStart(Repeat=0, Data_0=partition)  # -> port, Counter, Data_0
loop_end_2 = LoopEnd(port=loop_start_4.port, Exit=False, Data_0=addition_2, pausedState=False, state="Constant & Record")
panel_12 = Panel(addition_2)
addition_3 = Addition(A=loop_start_5.Data_0, B="2")
addition_4 = Addition(A=loop_start_5.Data_1, B="4")
# for rect (x,y,w,h)
# where x,y is origin
# w,h is size
split_2_2 = SplitList(List=loop_start_6.Data_0, Index=2)  # -> ListA, ListB
panel_13 = Panel(loop_end)
panel_14 = Panel(loop_end_2)
split_3 = SplitList(List=split_2_2.ListA, Index=1)  # -> ListA, ListB
loop_end_3 = LoopEnd(port=loop_start_5.port, Exit=False, Data_0=addition_3, Data_1=addition_4, pausedState=False, state="Last & Record")  # -> Data_0, Data_1
split_1 = SplitList(List=split_2_2.ListB, Index=1)  # -> ListA, ListB
pt = ConstructPoint(XCoordinate=split_3.ListA, YCoordinate=split_3.ListB, ZCoordinate=0)
loop_end_4 = LoopEnd(
    port=loop_start.port,
    Exit=False,
    Data_0=loop_end_3.Data_0,
    Data_1=loop_end_3.Data_1,
    pausedState=False,
    state="Last & Record")  # -> Data_0, Data_1
box = DomainBox(Base=pt, X=split_1.ListA, Y=split_1.ListB, Z=Domain(0, 2))
loop_end_5 = LoopEnd(port=loop_start_6.port, Exit=False, Data_0=box, pausedState=False, state="Last & Record")
loop_end_6 = LoopEnd(port=loop_start_2.port, Exit=False, Data_0=loop_end_5, pausedState=False, state="Last & Record")
panel_15 = Panel(loop_end_4.Data_0)
panel_16 = Panel(loop_end_4.Data_1)
panel_17 = Panel(loop_end_6)
